# Dynamo graph Error Clean Up - Straighten off axis elements.dyn (Dynamo 1.3.0.875)

boolean = BoolSelector(true)
getWarnings = Revit.WarningTools.GetWarnings(boolean)
watch = Watch(getWarnings.out1)
watch_2 = Watch(getWarnings.out0)
string = StringInput("slightly off axis")
contains = String.Contains(str=watch_2, searchFor=string)
filterByBoolMask = List.FilterByBoolMask(list=watch, mask=contains)
flatten = Flatten(filterByBoolMask.in)
location = Custom[Element.Location](element=flatten)  # Returns the location of an element as an XYZ (or if it's line-based the start and end point of the line), along with some booleans to help filtering the results. Use this for some element types (e.g. walls or lines) that do not work with the built-in Get Family Instance Location node.
straightenXY = Custom[Springs.Line.StraightenXY](line=location.curves)  # Checks a line's end points for irregularities and corrects them if they are at or below the specified margin. The default margin is 1/5000 of the curve length, which is conservative.
setLocation = Custom[Springs.Element.SetLocation](element=flatten, location=straightenXY)  # Attempts to modify the location of the input element. This can effectively add as a move comand in Revit. Works for both line based and point based elements.
watch_3 = Watch(setLocation)
